# Grasshopper definition P_One_Template.gh (Grasshopper 1.0.7)
# plug-ins: Robots

list = ValueList({"Bartlett-IRB120", "Bartlett-IRB1600", "Bartlett-KR6", "Bartlett-KR60", "Bartlett-UR10"}, selected="Bartlett-UR10")
load_robot = LoadRobotSystem(Name=list, Base=PlaneXY(0, 0, 0))

pt = Point(Point(0, 0, 37.28464926))
xy = XYPlane(Origin=pt)
brep = Brep(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)
tool = CreateTool(Name="DefaultGHTool", TCP=xy, Weight=0, Mesh=brep)  # -> Tool, TCP

crv = Curve(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)
divide = DivideCurve(Curve=crv, Count=10, Kinks=False)  # -> Points, Tangents, Parameters
xz = XZPlane(Origin=divide.Points)
list_2 = ValueList({"Joint", "Linear"}, selected="Joint")
speed = SpeedParameter()
zone = ZoneParameter()
target = CreateTarget(Plane=xz, Motion=list_2, Tool=tool.Tool, Speed=speed, Zone=zone, IsCartesian=True)

# ----
# check the path before uploading
# the targets to the robots
# check warning and error message
# before uploading
program = CreateProgram(Name="DefaultProgram", RobotSystem=load_robot, Targets1=target, StepSize=1)  # -> Program, Code, Duration, Warnings, Errors
panel = Panel(program.Warnings)
knob = ControlKnob(Decimals=2, Limit=True, Maximum=1, Minimum=0, Range=1, Value=0)
shatter = Shatter(Curve=reparameterize(reverse(crv)), Parameters=knob)
item = ListItem(List=shatter, Index=0, Wrap=True)
panel_2 = Panel(program.Errors)
sim = ProgramSimulation(Program=program.Program, Time=knob, Normalized=True)  # -> SystemMeshes, JointRotations, Plane, Index, Time, Program, Errors
preview = CustomPreview(Geometry=item, Shader=ColourSwatch(SwatchColor=RGB(255, 0, 0)))

# ----
# Upload program:
# 
# pressing upload will run your path
upload = Button()  # disabled
play = Button()  # disabled
pause = Button()  # disabled
panel_3 = Panel("192.168.0.10")  # disabled
remoteur = RemoteUR(Program=program.Program, IP=panel_3, Upload=upload, Play=play, Pause=pause)  # disabled

item_2 = ListItem(List=sim.Plane, Index=-1, Wrap=True)
deplane = DeconstructPlane(Plane=item_2)  # -> Origin, XAxis, YAxis, ZAxis
line = LineSDL(Start=deplane.Origin, Direction=deplane.XAxis, Length="100")
line_2 = LineSDL(Start=deplane.Origin, Direction=deplane.YAxis, Length="100")
line_3 = LineSDL(Start=deplane.Origin, Direction=deplane.ZAxis, Length="100")
preview_2 = CustomPreview(Geometry=line, Shader=ColourSwatch(SwatchColor=RGB(255, 0, 0)))
preview_3 = CustomPreview(Geometry=line_2, Shader=ColourSwatch(SwatchColor=RGB(0, 255, 0)))
preview_4 = CustomPreview(Geometry=line_3, Shader=ColourSwatch(SwatchColor=RGB(0, 0, 255)))
