# Grasshopper definition P_One_Workshop.gh (Grasshopper 1.0.7)
# plug-ins: Robots

# ----
# Curve
number_slider = Slider(8, range=0..100)
crv = Curve(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)
list = ValueList({"Bartlett-IRB120", "Bartlett-IRB1600", "Bartlett-KR6", "Bartlett-KR60", "Bartlett-KR500", "Bartlett-KR60 on track", "Bartlett-UR10", "Bartlett-KR60-FAKE", "Bartlett-TX200", "Bartlett-RX160"}, selected="Bartlett-UR10")
divide = DivideCurve(Curve=crv, Count=number_slider, Kinks=False)  # -> Points, Tangents, Parameters
list_2 = ValueList({"Joint", "Linear"}, selected="Linear")
load_robot = LoadRobotSystem(Name=list, Base=PlaneXY(0, 0, 0))
pl = ConstructPlane(Origin=divide.Points, XAxis="-1,0,0", YAxis=Vector(0, 1, 0))
target = CreateTarget(Plane=pl, Motion=list_2, IsCartesian=True)
program = CreateProgram(Name="DefaultProgram", RobotSystem=load_robot, Targets1=target, StepSize=1)  # -> Program, Code, Duration, Warnings, Errors
sim = ProgramSimulation(Program=program.Program, Time=Slider(1, range=0..1), Normalized=True)  # -> SystemMeshes, JointRotations, Plane, Index, Time, Program, Errors

# ----
# Polyline with fillet
number_slider_2 = Slider(1, range=0..10)
crv_2 = Curve(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)
divide_2 = DivideCurve(Curve=crv_2, Count=number_slider_2, Kinks=Toggle(True))  # -> Points, Tangents, Parameters
list_3 = ValueList({"Bartlett-IRB120", "Bartlett-IRB1600", "Bartlett-KR6", "Bartlett-KR60", "Bartlett-KR500", "Bartlett-KR60 on track", "Bartlett-UR10", "Bartlett-KR60-FAKE", "Bartlett-TX200", "Bartlett-RX160"}, selected="Bartlett-UR10")
item = ListItem(List=divide_2.Points, Index=0, Wrap=True)
number_slider_3 = Slider(10, range=0..10)
merge = Merge(Data1=divide_2.Points, Data2=item)
list_4 = ValueList({"Joint", "Linear"}, selected="Linear")
load_robot_2 = LoadRobotSystem(Name=list_3, Base=PlaneXY(0, 0, 0))
pl_2 = ConstructPlane(Origin=merge, XAxis="-1,0,0", YAxis=Vector(0, 1, 0))
zone = ZoneParameter(number_slider_3)
fillet = Fillet(Curve=crv_2, Radius=number_slider_3)
target_2 = CreateTarget(Plane=pl_2, Motion=list_4, Zone=zone, IsCartesian=True)
program_2 = CreateProgram(Name="DefaultProgram", RobotSystem=load_robot_2, Targets1=target_2, StepSize=1)  # -> Program, Code, Duration, Warnings, Errors
sim_2 = ProgramSimulation(Program=program_2.Program, Time=Slider(0, range=0..1), Normalized=True)  # -> SystemMeshes, JointRotations, Plane, Index, Time, Program, Errors

# ----
# Polyline
number_slider_4 = Slider(1, range=0..10)
crv_3 = Curve(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)
list_5 = ValueList({"Bartlett-IRB120", "Bartlett-IRB1600", "Bartlett-KR6", "Bartlett-KR60", "Bartlett-KR500", "Bartlett-KR60 on track", "Bartlett-UR10", "Bartlett-KR60-FAKE", "Bartlett-TX200", "Bartlett-RX160"}, selected="Bartlett-UR10")
divide_3 = DivideCurve(Curve=crv_3, Count=number_slider_4, Kinks=Toggle(True))  # -> Points, Tangents, Parameters
list_6 = ValueList({"Joint", "Linear"}, selected="Linear")
pl_3 = ConstructPlane(Origin=divide_3.Points, XAxis="-1,0,0", YAxis=Vector(0, 1, 0))
load_robot_3 = LoadRobotSystem(Name=list_5, Base=PlaneXY(0, 0, 0))
target_3 = CreateTarget(Plane=pl_3, Motion=list_6, IsCartesian=True)
program_3 = CreateProgram(Name="DefaultProgram", RobotSystem=load_robot_3, Targets1=target_3, StepSize=1)  # -> Program, Code, Duration, Warnings, Errors
sim_3 = ProgramSimulation(Program=program_3.Program, Time=Slider(0, range=0..1), Normalized=True)  # -> SystemMeshes, JointRotations, Plane, Index, Time, Program, Errors

# ----
# Moving the robot in joint space
# Moving the robot in cartesian space
list_7 = ValueList({"Bartlett-IRB120", "Bartlett-IRB1600", "Bartlett-KR6", "Bartlett-KR60", "Bartlett-UR10"}, selected="Bartlett-UR10")
axis1 = Slider(-136, range=-360..360)
axis2 = Slider(270, range=-360..360)
axis3 = Slider(-10, range=-360..360)
axis4 = Slider(150, range=-360..360)
axis5 = Slider(-52, range=-360..360)
axis6 = Slider(147, range=-360..360)
xy = XYPlane(Origin="0,-500,0")
merge_2 = Merge(Data1=axis1, Data2=axis2, Data3=axis3, Data4=axis4, Data5=axis5, Data6=axis6)
load_robot_4 = LoadRobotSystem(Name=list_7, Base=xy)
degtorad = DegreesToRadians(Degrees=merge_2, RobotSystem=load_robot_4, MechanicalGroup=0)
target_4 = CreateTarget(Joints=degtorad, IsCartesian=False)
K = Kinematics(RobotSystem=load_robot_4, Target=target_4, Geometry=True)  # -> MechanismMeshes, JointRotations, Plane, Errors
item_2 = ListItem(List=K.Plane, Index=-1, Wrap=True)
deplane = DeconstructPlane(Plane=item_2)  # -> Origin, XAxis, YAxis, ZAxis
list_8 = ValueList({"Bartlett-IRB120", "Bartlett-IRB1600", "Bartlett-KR6", "Bartlett-KR60", "Bartlett-UR10"}, selected="Bartlett-UR10")
Z = Slider(284, range=-500..500)
X = Slider(-24, range=-500..500)
Y = Slider(-389, range=-500..500)
A = Slider(-126, range=-180..180)
B = Slider(-38, range=-180..180)
C = Slider(146, range=-180..180)
xy_2 = XYPlane(Origin="0,500,0")
merge_3 = Merge(Data1=X, Data2=Y, Data3=Z, Data4=A, Data5=B, Data6=C)
load_robot_5 = LoadRobotSystem(Name=list_8, Base=xy_2)
list_9 = FlagFields({"Shoulder": 1, "Elbow": 2, "Wrist": 4}, selected=[])
getplane = GetPlane(Numbers=merge_3, RobotSystem=load_robot_5)
target_5 = CreateTarget(Plane=getplane, RobConf=list_9, IsCartesian=True)
K_2 = Kinematics(RobotSystem=load_robot_5, Target=target_5, Geometry=True)  # -> MechanismMeshes, JointRotations, Plane, Errors
item_3 = ListItem(List=K_2.Plane, Index=-1, Wrap=True)
deplane_2 = DeconstructPlane(Plane=item_3)  # -> Origin, XAxis, YAxis, ZAxis

# ----
# Curve with smoothing
number_slider_5 = Slider(46, range=0..100)
crv_4 = Curve(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)
len = Length(Curve=crv_4)
division = Division(A=len, B=number_slider_5)
list_10 = ValueList({"Bartlett-IRB120", "Bartlett-IRB1600", "Bartlett-KR6", "Bartlett-KR60", "Bartlett-KR500", "Bartlett-KR60 on track", "Bartlett-UR10", "Bartlett-KR60-FAKE", "Bartlett-TX200", "Bartlett-RX160"}, selected="Bartlett-UR10")
round = Round(Number=division)  # -> Nearest, Floor, Ceiling
number_slider_6 = Slider(5, range=0..10)
divide_4 = DivideCurve(Curve=crv_4, Count=round.Floor, Kinks=False)  # -> Points, Tangents, Parameters
list_11 = ValueList({"Joint", "Linear"}, selected="Linear")
load_robot_6 = LoadRobotSystem(Name=list_10, Base=PlaneXY(0, 0, 0))
pl_4 = ConstructPlane(Origin=divide_4.Points, XAxis="-1,0,0", YAxis=Vector(0, 1, 0))
zone_2 = ZoneParameter(number_slider_6)
cir = Circle(Plane=pl_4, Radius=number_slider_6)
target_6 = CreateTarget(Plane=pl_4, Motion=list_11, Zone=zone_2, IsCartesian=True)
program_4 = CreateProgram(Name="DefaultProgram", RobotSystem=load_robot_6, Targets1=target_6, StepSize=1)  # -> Program, Code, Duration, Warnings, Errors
sim_4 = ProgramSimulation(Program=program_4.Program, Time=Slider(0, range=0..1), Normalized=True)  # -> SystemMeshes, JointRotations, Plane, Index, Time, Program, Errors

line = LineSDL(Start=deplane.Origin, Direction=deplane.XAxis, Length=250)
line_2 = LineSDL(Start=deplane.Origin, Direction=deplane.YAxis, Length=250)
line_3 = LineSDL(Start=deplane.Origin, Direction=deplane.ZAxis, Length=250)
preview = CustomPreview(Geometry=line, Shader=ColourSwatch(SwatchColor=RGB(255, 0, 0)))
preview_2 = CustomPreview(Geometry=line_2, Shader=ColourSwatch(SwatchColor=RGB(0, 255, 0)))
preview_3 = CustomPreview(Geometry=line_3, Shader=ColourSwatch(SwatchColor=RGB(0, 0, 255)))

# ----
# Polyline with tangency
crv_5 = Curve(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)
explode = Explode(Curve=crv_5, Recursive=True)  # -> Segments, Vertices
item_4 = ListItem(List=explode.Segments, Index="-1", Wrap=True)
cull_i = CullIndex(List=explode.Segments, Indices=["0", "-1"], Wrap=True)
item_5 = ListItem(List=explode.Segments, Index="0", Wrap=True)
panel = Panel("""0
0.9""")
panel_2 = Panel("""0.1
0.9""")
panel_3 = Panel("""0.1
1""")
hframe = HorizontalFrame(Curve=reparameterize(graft(item_5)), Parameter=panel)  # -> flatten(Frame)
hframe_2 = HorizontalFrame(Curve=reparameterize(graft(cull_i)), Parameter=panel_2)  # -> flatten(Frame)
hframe_3 = HorizontalFrame(Curve=reparameterize(graft(item_4)), Parameter=panel_3)  # -> flatten(Frame)
merge_4 = Merge(Data1=hframe, Data2=hframe_2, Data3=hframe_3)
brep = Brep(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)
pt = Point(Point(1.126563715, 0, 115.7089961))
list_12 = ValueList({"Bartlett-IRB120", "Bartlett-IRB1600", "Bartlett-KR6", "Bartlett-KR60", "Bartlett-KR500", "Bartlett-KR60 on track", "Bartlett-UR10", "Bartlett-KR60-FAKE", "Bartlett-TX200", "Bartlett-RX160"}, selected="Bartlett-UR10")
deplane_3 = DeconstructPlane(Plane=merge_4)  # -> Origin, XAxis, YAxis, ZAxis
xy_3 = XYPlane(Origin=pt)
mesh = MeshBrep(
    Brep=brep,
    Settings={GridMaxCount=0, GridMinCount=16, JaggedSeams=False, MaxEdgeLength=0, MinEdgeLength=0.0001, MinTolerance=0, Refine=True, RefineAngle=0, RelativeTolerance=0.65, SimplePlanes=True, Tolerance=0})
pl_5 = ConstructPlane(Origin=deplane_3.Origin, XAxis=expr("-X", deplane_3.XAxis), YAxis=deplane_3.YAxis)
tool = CreateTool(Name="DefaultGHTool", TCP=xy_3, Weight=0, Mesh=mesh)  # -> Tool, TCP
list_13 = ValueList({"Joint", "Linear"}, selected="Linear")
load_robot_7 = LoadRobotSystem(Name=list_12, Base=PlaneXY(0, 0, 0))
target_7 = CreateTarget(Plane=pl_5, Motion=list_13, Tool=tool.Tool, IsCartesian=True)
program_5 = CreateProgram(Name="DefaultProgram", RobotSystem=load_robot_7, Targets1=target_7, StepSize=1)  # -> Program, Code, Duration, Warnings, Errors
sim_5 = ProgramSimulation(Program=program_5.Program, Time=Slider(0.181, range=0..1), Normalized=True)  # -> SystemMeshes, JointRotations, Plane, Index, Time, Program, Errors

# ----
# Curve with tangency
number_slider_7 = Slider(25, range=0..100)
crv_6 = Curve(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)
crv_7 = Curve(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)
hframes = HorizontalFrames(Curve=crv_6, Count=number_slider_7)  # -> Frames, Parameters
pframes = PerpFrames(Curve=crv_7, Count=Slider(20, range=0..100), Align=True)  # -> Frames, Parameters
brep_2 = Brep(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)
pt_2 = Point(Point(1.126563715, 0, 115.7089961))
list_14 = ValueList({"Bartlett-IRB120", "Bartlett-IRB1600", "Bartlett-KR6", "Bartlett-KR60", "Bartlett-KR500", "Bartlett-KR60 on track", "Bartlett-UR10", "Bartlett-KR60-FAKE", "Bartlett-TX200", "Bartlett-RX160"}, selected="Bartlett-UR10")
deplane_4 = DeconstructPlane(Plane=pframes.Frames)  # -> Origin, XAxis, YAxis, ZAxis
deplane_5 = DeconstructPlane(Plane=hframes.Frames)  # -> Origin, XAxis, YAxis, ZAxis
mesh_2 = MeshBrep(
    Brep=brep_2,
    Settings={GridMaxCount=0, GridMinCount=16, JaggedSeams=False, MaxEdgeLength=0, MinEdgeLength=0.0001, MinTolerance=0, Refine=True, RefineAngle=0, RelativeTolerance=0.65, SimplePlanes=True, Tolerance=0})
xy_4 = XYPlane(Origin=pt_2)
list_15 = ValueList({"Joint", "Linear"}, selected="Linear")
pl_6 = ConstructPlane(Origin=deplane_4.Origin, XAxis=expr("-X", deplane_4.XAxis), YAxis=deplane_4.YAxis)
tool_2 = CreateTool(Name="DefaultGHTool", TCP=xy_4, Weight=0, Mesh=mesh_2)  # -> Tool, TCP
pl_7 = ConstructPlane(Origin=deplane_5.Origin, XAxis=expr("-x", deplane_5.XAxis), YAxis=deplane_5.YAxis)
list_16 = ValueList({"Joint", "Linear"}, selected="Linear")
list_17 = ValueList({"Bartlett-IRB120", "Bartlett-IRB1600", "Bartlett-KR6", "Bartlett-KR60", "Bartlett-KR500", "Bartlett-KR60 on track", "Bartlett-UR10", "Bartlett-KR60-FAKE", "Bartlett-TX200", "Bartlett-RX160"}, selected="Bartlett-UR10")
target_8 = CreateTarget(Plane=pl_6, Motion=list_16, IsCartesian=True)
target_9 = CreateTarget(Plane=pl_7, Motion=list_15, Tool=tool_2.Tool, IsCartesian=True)
load_robot_8 = LoadRobotSystem(Name=list_14, Base=PlaneXY(0, 0, 0))
load_robot_9 = LoadRobotSystem(Name=list_17, Base=PlaneXY(0, 0, 0))
program_6 = CreateProgram(Name="DefaultProgram", RobotSystem=load_robot_9, Targets1=target_9, StepSize=1)  # -> Program, Code, Duration, Warnings, Errors
program_7 = CreateProgram(Name="DefaultProgram", RobotSystem=load_robot_8, Targets1=target_8, StepSize=1)  # -> Program, Code, Duration, Warnings, Errors
sim_6 = ProgramSimulation(Program=program_6.Program, Time=Slider(0, range=0..1), Normalized=True)  # -> SystemMeshes, JointRotations, Plane, Index, Time, Program, Errors
sim_7 = ProgramSimulation(Program=program_7.Program, Time=Slider(1, range=0..1), Normalized=True)  # -> SystemMeshes, JointRotations, Plane, Index, Time, Program, Errors

# ----
# line or curve with target
number_slider_8 = Slider(30, range=0..100)
list_18 = ValueList({"Bartlett-IRB120", "Bartlett-IRB1600", "Bartlett-KR6", "Bartlett-KR60", "Bartlett-UR10"}, selected="Bartlett-UR10")
crv_8 = Curve(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)
divide_5 = DivideCurve(Curve=crv_8, Count=number_slider_8, Kinks=False)  # -> Points, Tangents, Parameters
pt_3 = Point(Point(658.3600629, 1106.341841, 154.2178653))
pt_4 = ConstructPoint(XCoordinate=0, YCoordinate=1000, ZCoordinate=0)
vec2pt = Vector2Pt(PointA=divide_5.Points, PointB=pt_3, Unitize=False)  # -> Vector, Length
xy_5 = XYPlane(Origin=pt_4)
pl_8 = PlaneNormal(Origin=divide_5.Points, ZAxis=vec2pt.Vector)
load_robot_10 = LoadRobotSystem(Name=list_18, Base=xy_5)
list_19 = ValueList({"Joint", "Linear"}, selected="Linear")
align = AlignPlanes(Planes=pl_8)
target_10 = CreateTarget(Plane=align, Motion=list_19, IsCartesian=True)
program_8 = CreateProgram(Name="DefaultProgram", RobotSystem=load_robot_10, Targets1=target_10, StepSize=1)  # -> Program, Code, Duration, Warnings, Errors
knob = ControlKnob(Decimals=2, Limit=True, Maximum=1, Minimum=0, Range=1, Value=0)
sim_8 = ProgramSimulation(Program=program_8.Program, Time=knob, Normalized=True)  # -> SystemMeshes, JointRotations, Plane, Index, Time, Program, Errors

line_4 = LineSDL(Start=deplane_2.Origin, Direction=deplane_2.XAxis, Length=250)
line_5 = LineSDL(Start=deplane_2.Origin, Direction=deplane_2.YAxis, Length=250)
line_6 = LineSDL(Start=deplane_2.Origin, Direction=deplane_2.ZAxis, Length=250)
preview_4 = CustomPreview(Geometry=line_4, Shader=ColourSwatch(SwatchColor=RGB(255, 0, 0)))
preview_5 = CustomPreview(Geometry=line_5, Shader=ColourSwatch(SwatchColor=RGB(0, 255, 0)))
preview_6 = CustomPreview(Geometry=line_6, Shader=ColourSwatch(SwatchColor=RGB(0, 0, 255)))

# ----
# e.g. light drawing dotted line
number_slider_9 = Slider(10, range=0..10)
crv_9 = Curve(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)
setdo = SetDO(DO=Slider(0, range=0..100), Value=Slider(1, range=0..1))
setdo_2 = SetDO(DO=Slider(0, range=0..100), Value=Slider(0, range=0..1))
divdist = DivideDistance(Curve=crv_9, Distance=number_slider_9)  # -> Points, Tangents, Parameters
wait = Wait(Time=Slider(1, range=0..10))
yz = YZPlane(Origin=divdist.Points)
groupcmd = GroupCommand(Commands=[setdo, wait, setdo_2])
item_6 = ListItem(List=yz, Index="0", Wrap=True)
cull_i_2 = CullIndex(List=yz, Indices="0", Wrap=True)
list_20 = FlagFields({"Shoulder": 1, "Elbow": 2, "Wrist": 4}, selected="Wrist")
list_21 = ValueList({"Joint", "Linear"}, selected="Linear")
list_22 = ValueList({"Joint", "Linear"}, selected="Joint")
target_11 = CreateTarget(Plane=cull_i_2, Motion=list_21, Command=groupcmd, IsCartesian=True)
target_12 = CreateTarget(Plane=item_6, RobConf=list_20, Motion=list_22, Command=groupcmd, IsCartesian=True)
list_23 = ValueList({"Bartlett-IRB120", "Bartlett-IRB1600", "Bartlett-KR6", "Bartlett-KR60", "Bartlett-UR10"}, selected="Bartlett-UR10")
merge_5 = Merge(Data1=flatten(target_12), Data2=flatten(target_11))
load_robot_11 = LoadRobotSystem(Name=list_23, Base=PlaneXY(0, 0, 0))
program_9 = CreateProgram(Name="DefaultProgram", RobotSystem=load_robot_11, Targets1=merge_5, StepSize=1)  # -> Program, Code, Duration, Warnings, Errors
knob_2 = ControlKnob(Decimals=3, Limit=True, Maximum=1, Minimum=0, Range=1, Value=1)
sim_9 = ProgramSimulation(Program=program_9.Program, Time=knob_2, Normalized=True)  # -> SystemMeshes, JointRotations, Plane, Index, Time, Program, Errors

# ----
# e.g. light drawing solid lines
number_slider_10 = Slider(10, range=0..10)
crv_10 = Curve([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])
pt_5 = Point(Point(0, 0, 37.28464926))
divdist_2 = DivideDistance(Curve=crv_10, Distance=number_slider_10)  # -> Points, Tangents, Parameters
panel_4 = Panel("""0
-1""")
xy_6 = XYPlane(Origin=pt_5)
brep_3 = Brep(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)
yz_2 = YZPlane(Origin=divdist_2.Points)
tool_3 = CreateTool(Name="DefaultGHTool", TCP=xy_6, Weight=0, Mesh=brep_3)  # -> Tool, TCP
cull_i_3 = CullIndex(List=yz_2, Indices=panel_4, Wrap=True)
item_7 = ListItem(List=yz_2, Index=0, Wrap=True)  # -> Item1, Item
list_24 = ValueList({"Joint", "Linear"}, selected="Linear")
tool_4 = ToolParameter(tool_3.Tool)
speed = SpeedParameter(Slider(50, range=0..100))
zone_3 = ZoneParameter(Slider(5, range=0..10))
list_25 = FlagFields({"Shoulder": 1, "Elbow": 2, "Wrist": 4}, selected="Wrist")
list_26 = ValueList({"Joint", "Linear"}, selected="Joint")
setdo_3 = SetDO(DO="0", Value="1")
setdo_4 = SetDO(DO="0", Value="0")
target_13 = CreateTarget(
    Plane=item_7.Item,
    RobConf=list_25,
    Motion=list_26,
    Tool=tool_4,
    Speed=speed,
    Zone=zone_3,
    Command=setdo_3,
    IsCartesian=True)
target_14 = CreateTarget(Plane=cull_i_3, Motion=list_24, Tool=tool_4, Speed=speed, Zone=zone_3, IsCartesian=True)
target_15 = CreateTarget(Plane=item_7.Item1, Motion=list_24, Tool=tool_4, Speed=speed, Zone=zone_3, Command=setdo_4, IsCartesian=True)
ins = InsertItems(List=target_14, Item=target_13, Indices="0", Wrap=True)
list_27 = ValueList({"Bartlett-IRB120", "Bartlett-IRB1600", "Bartlett-KR6", "Bartlett-KR60", "Bartlett-UR10"}, selected="Bartlett-UR10")
ins_2 = InsertItems(List=ins, Item=target_15, Indices="-1", Wrap=True)  # -> flatten(List)
load_robot_12 = LoadRobotSystem(Name=list_27, Base=PlaneXY(0, 0, 0))
program_10 = CreateProgram(Name="DefaultProgram", RobotSystem=load_robot_12, Targets1=ins_2, StepSize=1)  # -> Program, Code, Duration, Warnings, Errors
knob_3 = ControlKnob(Decimals=2, Limit=True, Maximum=1, Minimum=0, Range=1, Value=0)
sim_10 = ProgramSimulation(Program=program_10.Program, Time=knob_3, Normalized=True)  # -> SystemMeshes, JointRotations, Plane, Index, Time, Program, Errors

# ----
# e.g. light drawing solid lines
crv_11 = Curve([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])
pt_6 = Point(Point(0, 0, 37.28464926))
divdist_3 = DivideDistance(Curve=crv_11, Distance=Slider(10, range=0..10))  # -> Points, Tangents, Parameters
xy_7 = XYPlane(Origin=pt_6)
brep_4 = Brep(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)
yz_3 = YZPlane(Origin=divdist_3.Points)  # -> simplify(Plane)
tool_5 = CreateTool(Name="DefaultGHTool", TCP=xy_7, Weight=0, Mesh=brep_4)  # -> Tool, TCP
panel_5 = Panel("""0
-1""")
cull_i_4 = CullIndex(List=yz_3, Indices=panel_5, Wrap=True)
item_8 = ListItem(List=yz_3, Index=0, Wrap=True)  # -> Item1, Item
list_28 = ValueList({"Joint", "Linear"}, selected="Linear")
tool_6 = ToolParameter(tool_5.Tool)
speed_2 = SpeedParameter(Slider(50, range=0..100))
zone_4 = ZoneParameter(Slider(5, range=0..10))
list_29 = FlagFields({"Shoulder": 1, "Elbow": 2, "Wrist": 4}, selected="Wrist")
list_30 = ValueList({"Joint", "Linear"}, selected="Joint")
setdo_5 = SetDO(DO="0", Value="0")
setdo_6 = SetDO(DO="0", Value="1")
target_16 = CreateTarget(
    Plane=item_8.Item,
    RobConf=list_29,
    Motion=list_30,
    Tool=tool_6,
    Speed=speed_2,
    Zone=zone_4,
    Command=setdo_6,
    IsCartesian=True)
target_17 = CreateTarget(Plane=cull_i_4, Motion=list_28, Tool=tool_6, Speed=speed_2, Zone=zone_4, IsCartesian=True)
target_18 = CreateTarget(Plane=item_8.Item1, Motion=list_28, Tool=tool_6, Speed=speed_2, Zone=zone_4, Command=setdo_5, IsCartesian=True)
list_31 = ValueList({"Bartlett-IRB120", "Bartlett-IRB1600", "Bartlett-KR6", "Bartlett-KR60", "Bartlett-UR10"}, selected="Bartlett-UR10")
merge_6 = Merge(Data1=simplify(target_16), Data2=simplify(target_17), Data3=simplify(target_18))  # -> flatten(Result)
load_robot_13 = LoadRobotSystem(Name=list_31, Base=PlaneXY(0, 0, 0))
program_11 = CreateProgram(Name="DefaultProgram", RobotSystem=load_robot_13, Targets1=merge_6, StepSize=1)  # -> Program, Code, Duration, Warnings, Errors
knob_4 = ControlKnob(Decimals=2, Limit=True, Maximum=1, Minimum=0, Range=1, Value=0)
sim_11 = ProgramSimulation(Program=program_11.Program, Time=knob_4, Normalized=True)  # -> SystemMeshes, JointRotations, Plane, Index, Time, Program, Errors

# ----
# e.g. light drawing solid line
number_slider_11 = Slider(10, range=0..10)
crv_12 = Curve(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)
pt_7 = Point(Point(0, 0, 37.28464926))
divdist_4 = DivideDistance(Curve=crv_12, Distance=number_slider_11)  # -> Points, Tangents, Parameters
panel_6 = Panel("""0
-1""")
xy_8 = XYPlane(Origin=pt_7)
brep_5 = Brep(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)
yz_4 = YZPlane(Origin=divdist_4.Points)
tool_7 = CreateTool(Name="DefaultGHTool", TCP=xy_8, Weight=0, Mesh=brep_5)  # -> Tool, TCP
cull_i_5 = CullIndex(List=yz_4, Indices=panel_6, Wrap=True)
item_9 = ListItem(List=yz_4, Index=0, Wrap=True)  # -> Item1, Item
list_32 = ValueList({"Joint", "Linear"}, selected="Linear")
tool_8 = ToolParameter(tool_7.Tool)
speed_3 = SpeedParameter(Slider(50, range=0..100))
zone_5 = ZoneParameter(Slider(5, range=0..10))
list_33 = FlagFields({"Shoulder": 1, "Elbow": 2, "Wrist": 4}, selected="Wrist")
list_34 = ValueList({"Joint", "Linear"}, selected="Joint")
setdo_7 = SetDO(DO="0", Value="1")
setdo_8 = SetDO(DO="0", Value="0")
target_19 = CreateTarget(
    Plane=item_9.Item,
    RobConf=list_33,
    Motion=list_34,
    Tool=tool_8,
    Speed=speed_3,
    Zone=zone_5,
    Command=setdo_7,
    IsCartesian=True)
target_20 = CreateTarget(Plane=cull_i_5, Motion=list_32, Tool=tool_8, Speed=speed_3, Zone=zone_5, IsCartesian=True)
target_21 = CreateTarget(Plane=item_9.Item1, Motion=list_32, Tool=tool_8, Speed=speed_3, Zone=zone_5, Command=setdo_8, IsCartesian=True)
merge_7 = Merge(Data1=flatten(target_19), Data2=flatten(target_20), Data3=flatten(target_21))
list_35 = ValueList({"Bartlett-IRB120", "Bartlett-IRB1600", "Bartlett-KR6", "Bartlett-KR60", "Bartlett-UR10"}, selected="Bartlett-UR10")
knob_5 = ControlKnob(Decimals=2, Limit=True, Maximum=1, Minimum=0, Range=1, Value=0)
load_robot_14 = LoadRobotSystem(Name=list_35, Base=PlaneXY(0, 0, 0))
program_12 = CreateProgram(Name="DefaultProgram", RobotSystem=load_robot_14, Targets1=merge_7, StepSize=1)  # -> Program, Code, Duration, Warnings, Errors
sim_12 = ProgramSimulation(Program=program_12.Program, Time=knob_5, Normalized=True)  # -> SystemMeshes, JointRotations, Plane, Index, Time, Program, Errors

crv_13 = Curve(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)
divide_6 = DivideCurve(Curve=crv_13, Count=10, Kinks=False)  # -> Points, Tangents, Parameters
xz = XZPlane(Origin=divide_6.Points)

list_36 = ValueList({"Joint", "Linear"}, selected="Joint")
target_22 = CreateTarget(Plane=xz, Motion=list_36, Speed=Slider(34, range=0..100), Zone=Slider(6, range=0..10), IsCartesian=True)

list_37 = ValueList({"Bartlett-IRB120", "Bartlett-IRB1600", "Bartlett-KR6", "Bartlett-KR60", "Bartlett-UR10"}, selected="Bartlett-UR10")
load_robot_15 = LoadRobotSystem(Name=list_37, Base=PlaneXY(0, 0, 0))
program_13 = CreateProgram(Name="DefaultProgram", RobotSystem=load_robot_15, Targets1=target_22, StepSize=1)  # -> Program, Code, Duration, Warnings, Errors

# ----
# check the path before uploading
# the targets to the robots
# check warning and error message
# before uploading
shatter = Shatter()
number_slider_12 = Slider(0.844, range=0..1)
panel_7 = Panel(program_13.Errors)
panel_8 = Panel(program_13.Warnings)
item_10 = ListItem(List=shatter, Index=number_slider_12, Wrap=True)

# ----
# Upload program
upload = Button()  # disabled
play = Button()  # disabled
pause = Button()  # disabled
panel_9 = Panel("192.168.0.10")  # disabled
remoteur = RemoteUR(Program=program_13.Program, IP=panel_9, Upload=upload, Play=play, Pause=pause)  # disabled

sim_13 = ProgramSimulation(Program=program_13.Program, Time=number_slider_12, Normalized=True)  # -> SystemMeshes, JointRotations, Plane, Index, Time, Program, Errors
crv_14 = Curve(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)
divide_7 = DivideCurve(Curve=crv_14, Count=10, Kinks=False)  # -> Points, Tangents, Parameters
yz_5 = YZPlane(Origin=divide_7.Points)

# ----
# multiple digital output on single target
number_slider_13 = Slider(0.1, range=0..1)
setdo_9 = SetDO(DO=Slider(0, range=0..1), Value=Slider(0, range=0..1))
setdo_10 = SetDO(DO=Slider(0, range=0..1), Value=Slider(1, range=0..1))
wait_2 = Wait(Time=number_slider_13)
groupcmd_2 = GroupCommand(Commands=[setdo_9, wait_2, setdo_10])

# ----
# digital output on start and end targets
number_slider_14 = Slider(0, range=0..1)
panel_10 = Panel("""0
-1""")
setdo_11 = SetDO(DO=number_slider_14, Value=Slider(1, range=0..1))
setdo_12 = SetDO(DO=Slider(0, range=0..1), Value=Slider(0, range=0..1))
cull_i_6 = CullIndex(List=yz_5, Indices=panel_10, Wrap=True)
item_11 = ListItem(List=yz_5, Index=0, Wrap=True)
item_12 = ListItem(List=yz_5, Index=-1, Wrap=True)

list_38 = ValueList({"Joint", "Linear"}, selected="Linear")
list_39 = ValueList({"Joint", "Linear"}, selected="Linear")
list_40 = ValueList({"Joint", "Linear"}, selected="Linear")
target_23 = CreateTarget(Plane=item_11, Motion=list_38, Command=setdo_11, IsCartesian=True)
target_24 = CreateTarget(Plane=cull_i_6, Motion=list_39, IsCartesian=True)
target_25 = CreateTarget(Plane=item_12, Motion=list_40, Command=setdo_12, IsCartesian=True)

panel_11 = Panel(item_11)

merge_8 = Merge(Data1=flatten(target_23), Data2=flatten(target_24))
merge_9 = Merge(Data1=merge_8, Data2=target_25)  # -> flatten(Result)

panel_12 = Panel(merge_8)
